vi "Aggregate Sub-band into Spectrum.gvi"   [LabVIEW Communications System Design Software 2.0.1]
inputs:
  "Frame Parameters": T1
  "Power Spectrum Subset": T3
  "Window Properties In": T4
  "Reset": bool
  "Iteration": i32
outputs:
  "Window Properties Out": T4
  "Spectrum to Plot": cluster{"f0": f64, "df": f64, "IQ": f64[]}
  "Frame Parameters Out": T1
panel controls:
  "Initialize Spectrum": cluster{"f0": f64, "df": f64, "IQ": f64[]}
panel indicators:
  "Sizes (testing)": T2
types:
  T1 = cluster{"IQ Rate": f64, "Frames": i32, "Length of Subset": i32, "Start Carrier [Hz": f64, "Stop Carrier [Hz]": f64, "Acq Duration [Sec]": f64, "Start Index of Subset": i32}
  T2 = cluster{"Before Edges Cut": i32, "After Edges Cut": i32, "Total Samples in Spectrum": i32}
  T3 = cluster{"f0": f64, "df": f64, "magnitude": f64[]}
  T4 = cluster{"eq noise bw": f64, "coherent gain": f64}
diagram:
  Property Node(instance in=$"Frame Parameters") -> ("Frames"=w1, "Length of Subset"=w2, "Start Index of Subset"=w3, instance out=w4)
  Multiply(w1, w2) -> w5
  # Reset is unused
  Is First Call() -> w6
  Logical Or(w6, $Reset) -> w7
  # w3: Start Index
  Property Node(instance in=$"Power Spectrum Subset") -> ("df"=w8, "magnitude"=w9)
  Feedback Node(input=w10) -> w11
  case (w7) {
    frame False, Default {
      w12 = w11
    }
    frame True {
      Initialize Array(element=0, size=w5) -> w13
      # Initialize Spectrum History
      Property Node(instance in=$"Initialize Spectrum", "df"=w8, "IQ"=w13) -> (instance out=w12)
    }
  }
  # Remove Edges of
  # Sub Spectrum
  Array Subset(array=w9, index0=w3, length0=w2) -> w14
  Multiply($Iteration, w2) -> w15
  in-place (after w12) {
    Unbundle Bundle Read Poser() -> ("IQ"=w16)
    # Add Current Spectrum to Spectrum History
    Replace Array Subset(inArray=w16, index=w15, new=w14) -> w17
    Unbundle Bundle Write Poser("IQ"=w17)
    w10 = _
  }
  $"Spectrum to Plot" <- w10
  # w2: Length of Subset
  $"Frame Parameters Out" <- w4
  Array Size(array=w9) -> (size(s)=w18)
  Array Size(array=w14) -> (size(s)=w19)
  Property Node(instance in=w10) -> ("IQ"=w20)
  Array Size(array=w20) -> (size(s)=w21)
  Build Cluster(w18, w19, w21) -> w22
  $"Sizes (testing)" <- w22
  $"Window Properties Out" <- $"Window Properties In"
