vi "Plot Spectrum.gvi"   [LabVIEW Communications System Design Software 2.0.1]
inputs:
  "Frame Parameters": T1
  "Spectrum to Plot In": cluster{"f0": f64, "df": f64, "IQ": f64[]}
outputs:
  "Spectrum to Plot Out": cluster{"f0": f64, "df": f64, "IQ": f64[]}
panel controls:
  "Spectrum to Plot Initialize": cluster{"f0": f64, "df": f64, "IQ": f64[]}
types:
  T1 = cluster{"IQ Rate": f64, "Frames": i32, "Length of Subset": i32, "Start Carrier [Hz": f64, "Stop Carrier [Hz]": f64, "Acq Duration [Sec]": f64, "Start Index of Subset": i32}
diagram:
  Property Node(instance in=$"Spectrum to Plot In") -> ("df"=w1)
  Property Node(instance in=$"Frame Parameters") -> ("Start Carrier [Hz"=w2, "Start Index of Subset"=w3)
  Multiply(w3, w1) -> w4
  Subtract(x=w2, y=w4) -> w5
  Property Node(instance in=$"Spectrum to Plot Initialize", "f0"=w5, "df"=w1) -> (instance out=w6)
  $"Spectrum to Plot Out" <- w6
