vi "Read From File.gvi"   [LabVIEW Communications System Design Software 2.0.1]
inputs:
  "B": i32
panel controls:
  "file path": path
  "FFT Initialize": cluster{"f0": f64, "df": f64, "IQ": f64[]}
panel indicators:
  "loop iteration": i32
  "group/channel names": string[][]
  "property values": variant[]
  "property names": string[]
  "FFT Power Spectrum": cluster{"f0": f64, "df": f64, "IQ": f64[]}
diagram:
  TDMS Open(file path=$"file path", operation="open (read-only)") -> (tdms file out=w1)
  Multiply($B, 2) -> w2
  Increment(x=w2) -> w3
  while (iteration -> i1) {
    TDMS Get Properties(tdms file=w1) -> (property names=w4, property values=w5)
    $"property values" <- w5
    $"property names" <- w4
    TDMS List Contents(tdms file=w1) -> (group/channel names=w6)
    $"group/channel names" <- w6
    Wait(time to wait=2)
    $"loop iteration" <- i1
    To Quad Integer(number=w3) -> w7
    TDMS Read(count=w7, offset=i1, return channels in file order=TRUE, tdms file=w1) -> (data=w8, end of file?=w9, tdms file out=w10)
    Array Size(array=w8) -> (size(s)=w11)
    for (N = w11) {
      w12 = each element of w8
      Property Node(instance in=w12) -> ("Y"=w13, "t0"=w14, "dt"=w15)
      To Double Precision Float(number=w14) -> w16
      Property Node(instance in=$"FFT Initialize", "f0"=w16, "df"=w15, "IQ"=w13) -> (instance out=w17)
    }
    $"FFT Power Spectrum" <- w17
    stop if w9
  }
  TDMS Close(tdms file=w10)
