vi "Spectrum Monitor (no saving).gvi"   [LabVIEW Communications System Design Software 2.0.1]
outputs:
  "LO Frequency": f64
  "Spectrum Size": i32
  "Frame Parameters Out": T5
panel controls:
  "RX Parameters In": T1 = {"IQ Sampling Rate [S/sec]"=20000000, "Gain [dB]"=0, "Reference Frequency"="Internal", "Timebase Clock Source"="Internal", "Start Carrier [Hz]"=75000000, "Stop Carrier [Hz]"=125000000, "Acq Duration [sec]"=0.0001, "Active Antenna"="RX2"}
  "Device Names": "niUSRPClass" = "192.168.10.2"
  "Averaging Parameters": "Averaging Parameters.gtype" = {"averaging mode"="RMS averaging", "weighting mode"="Linear", "number of averages"=4}  # averaging parameters defines how the averaging is computed. The specifications of the parameters include the type of averaging, the type of weighting, and the number of averages.
  "Display": T4 = {"display unit"="Vrms", "dB type"="dB"}
  "Stop Capture": bool
  "Tab": i32
  "threshold": f64 = -60
  "IQ frac": enum{"0.25", "0.5", "0.6", "0.8"} = "0.25"
  "Waterfall History Length": i32 = 1
panel indicators:
  "error out": error
  "Samples per Acquisition": i64
  "Carrier Freq Out": f64
  "FFT Power Spectrum": cluster{"f0": f64, "df": f64, "IQ": f64[]}
  "Carrier List": f64[]
  "Power Detection": "Power Detection cluster.gtype"
  "Waterfall Plot": f64[][]
  "period (ms)": u32
types:
  T1 = cluster{"IQ Sampling Rate [S/sec]": f64, "Gain [dB]": f64, "Reference Frequency": string, "Timebase Clock Source": string, "Start Carrier [Hz]": f64, "Stop Carrier [Hz]": f64, "Acq Duration [sec]": f64, "Active Antenna": string}
  T2 = enum{"No averaging", "Vector averaging", "RMS averaging", "Peak hold"}
  "Averaging Parameters.gtype" = cluster{"averaging mode": T2, "weighting mode": enum{"Linear", "Exponential"}, "number of averages": u32}
  T3 = enum{"Vrms", "Vpk", "Vrms^2", "Vpk^2", "Vrms/rtHz", "Vpk/rtHz", "Vrms^2/Hz", "Vpk^2/Hz"}
  T4 = cluster{"display unit": T3, "dB type": enum{"Linear", "dB", "dBm"}}
  T5 = cluster{"IQ Rate": f64, "Frames": i32, "Length of Subset": i32, "Start Carrier [Hz": f64, "Stop Carrier [Hz]": f64, "Acq Duration [Sec]": f64, "Start Index of Subset": i32}
  "Power Detection cluster.gtype" = cluster{"Estimated Freqs. above Threshold": f64[], "Power at those Freqs.": f64[], "Num. peaks detected": i32, "Num. in queue": i32}
diagram:
  call "niUSRP Open Rx Session.gvi"(niUSRP Device=$"Device Names") -> (error out=w1, session handle out=w2)
  call "Set Parameters.gvi"(RX Parameters In=$"RX Parameters In", USRP Session Handle In=w2, error in (no error)=w1, IQ frac=$"IQ frac") -> (error out: HW RX Param subsetup=w3, USRP Session Handle Out=w4, Test Carrier Frequencies=w5, Samples per Acquisition=w6, Frame Parameters Out=w7, IQ frac out=w8)
  call "niUSRP Configure Number of Samples.gvi"(session handle=w4, number of samples is finite=TRUE, number of samples=w6, error in (no error)=w3) -> (session handle out=w9, Error Out=w10)
  w11 = $"Waterfall History Length"
  Tick Count() -> (timer value=w12)
  # Testing Spectrum Monitor. Not as many indicators will
  # be on panel in final version.
  while {
    w13 = $"Averaging Parameters"
    w14 = $Display
    # Go back to the first carrier frequency and repeat
    s1 = 0  # shift register
    for (iteration -> i1) (after w8) {
      w15 = each element of w5
      call "Set Carrier and LO_2.gvi"(Current Frequency=w15, niusrp in_2=w9, error in=w10) -> (Error=w16, Usrp.niUSRPClass=w17)
      # Get new carrier frequency
      Property Node(instance in=w13) -> ("number of averages"=w18, instance out=w19)
      To Long Integer(number=w18) -> w20
      for (N = w20) (iteration -> i2) {
        # Averaging Loop
        call "Read Data.gvi"(USRP Session Handle In=w17, error in=w16, Number of Samples=w6) -> (USRP Session Handle Out=w22, error out=w23, data=w24)
        Is Equal To 0(x=i2) -> w25
        call "Establish Sub-band.gvi"(Restart Averaging=w25, Frame Parameters=w7, Averaging Parameters=w19, error in=w23, Input Baseband IQ=w24) -> (Power Spectrum averaged Subset=w26, Window Properties=w27, error out=w28, Frame Parameters Out=w29)
        # w25: First Rx for this carrier?
        Logical Or(w28, $"Stop Capture") -> w30
        append w28 to w21
        stop if w30
      }
      Merge Errors(w21) -> (error out=w31)
      Property Node(instance in=w22, error in=w31) -> ("Carrier Frequency"=w32, "LO Frequency"=w33, error out=w34, instance out=w35)
      $"Carrier Freq Out" <- w32
      $"LO Frequency" <- w33
      call "Aggregate Sub-band into Spectrum.gvi"(Frame Parameters=w29, Power Spectrum Subset=w26, Window Properties In=w27, Display=w14, Iteration=i1) -> (Spectrum to Plot=w36, Frame Parameters Out=w37, Spectrum Size=w38)
      call "Plot Spectrum.gvi"(Frame Parameters=w37, Spectrum to Plot In=w36) -> (Spectrum to Plot Out=w39, Frame Parameters out=w40)
      $"FFT Power Spectrum" <- w39
      $"Spectrum Size" <- w38
      next s1 = w33
      stop if w30
    }
    call "Signal Power Detection_2.gvi"(Power Spectrum=w39, threshold=$threshold, Frame Parameters Out=w40) -> (Power at those Freqs.=w41, Est. Freqs above Thresh=w42, count=w43, sub_band_ind=w44)
    call "Array Fill.gvi"(sub_band_ind=w44, Est. Freqs above Thresh=w42, Count=w43) -> (number elements in array=w45)
    Build Cluster(w42, w41, w43, w45) -> w46
    $"Power Detection" <- w46
    Property Node(instance in=w39) -> ("IQ"=w47)
    call "Waterfal Plot Generator.gvi"(Magnitude=w47, Waterfall History Length=w11) -> (Waterfall Plot=w48)
    $"Waterfall Plot" <- w48
    Tick Count() -> (timer value=w49)
    Feedback Node(initial value=w12, input=w49) -> w50
    Subtract(x=w49, y=w50) -> w51
    $"period (ms)" <- w51
    stop if w30
  }
  call "niUSRP Abort.gvi"(Handle in=w35, error in (no error)=w34) -> (Handle out=w52, Error Out=w53)
  call "niUSRP Close Session.gvi"(handle in=w52, error in=w53) -> (error out=w54)
  $"error out" <- w54
  $"Carrier List" <- w5
  $"Samples per Acquisition" <- w6
  $"Frame Parameters Out" <- w7
