vi "Spectrum Monitor.gvi"   [LabVIEW Communications System Design Software 2.0.1]
outputs:
  "LO Frequency": f64
  "Spectrum Size": i32
  "Frame Parameters Out": T5
panel controls:
  "RX Parameters In": T1 = {"IQ Sampling Rate [S/sec]"=20000000, "Gain [dB]"=0, "Reference Frequency"="Internal", "Timebase Clock Source"="Internal", "Start Carrier [Hz]"=95000000, "Stop Carrier [Hz]"=105000000, "Acq Duration [sec]"=0.0001, "Active Antenna"="RX2"}
  "Device Names": "niUSRPClass" = "192.168.10.2"
  "Averaging Parameters": "Averaging Parameters.gtype" = {"averaging mode"="RMS averaging", "weighting mode"="Linear", "number of averages"=4}  # averaging parameters defines how the averaging is computed. The specifications of the parameters include the type of averaging, the type of weighting, and the number of averages.
  "Display": T4 = {"display unit"="Vrms", "dB type"="dB"}
  "Stop Capture": bool
  "Tab": i32
  "threshold": f64 = -40
  "IQ frac": enum{"0.25", "0.5", "0.6", "0.8"} = "0.25"
  "file path": path
  "Waterfall Time Scale (s)": i32 = 5
panel indicators:
  "error out": error
  "Samples per Acquisition": i64
  "Carrier Freq Out": f64
  "FFT Power Spectrum": cluster{"f0": f64, "df": f64, "IQ": f64[]}
  "Carrier List": f64[]
  "Power Detection": "Power Detection cluster.gtype"
  "2D(freq,ind)": f64[][]
  "signals3D": f64[][][]
  "Waterfall Plot": f64[][]
  "Signal Data": "Signal Data.gtype"
types:
  T1 = cluster{"IQ Sampling Rate [S/sec]": f64, "Gain [dB]": f64, "Reference Frequency": string, "Timebase Clock Source": string, "Start Carrier [Hz]": f64, "Stop Carrier [Hz]": f64, "Acq Duration [sec]": f64, "Active Antenna": string}
  T2 = enum{"No averaging", "Vector averaging", "RMS averaging", "Peak hold"}
  "Averaging Parameters.gtype" = cluster{"averaging mode": T2, "weighting mode": enum{"Linear", "Exponential"}, "number of averages": u32}
  T3 = enum{"Vrms", "Vpk", "Vrms^2", "Vpk^2", "Vrms/rtHz", "Vpk/rtHz", "Vrms^2/Hz", "Vpk^2/Hz"}
  T4 = cluster{"display unit": T3, "dB type": enum{"Linear", "dB", "dBm"}}
  T5 = cluster{"IQ Rate": f64, "Frames": i32, "Length of Subset": i32, "Start Carrier [Hz": f64, "Stop Carrier [Hz]": f64, "Acq Duration [Sec]": f64, "Start Index of Subset": i32}
  "Power Detection cluster.gtype" = cluster{"Estimated Freqs. above Threshold": f64[], "Power at those Freqs.": f64[], "Num. peaks detected": i32, "Num. in queue": i32}
  "Signal Data.gtype" = cluster{"fc": f64[], "df": f64, "B": u32, "Trigger Save?": bool}
diagram:
  call "niUSRP Open Rx Session.gvi"(niUSRP Device=$"Device Names") -> (error out=w1, session handle out=w2)
  call "Set Parameters.gvi"(RX Parameters In=$"RX Parameters In", USRP Session Handle In=w2, error in (no error)=w1, IQ frac=$"IQ frac") -> (error out: HW RX Param subsetup=w3, USRP Session Handle Out=w4, Test Carrier Frequencies=w5, Samples per Acquisition=w6, Frame Parameters Out=w7, IQ frac out=w8)
  Property Node(instance in=$"Averaging Parameters") -> ("number of averages"=w9, instance out=w10)
  call "niUSRP Configure Number of Samples.gvi"(session handle=w4, number of samples is finite=TRUE, number of samples=w6, error in (no error)=w3) -> (session handle out=w11, Error Out=w12)
  To Long Integer(number=w9) -> w13
  w14 = $"file path"
  w15 = $Display
  w16 = $"Waterfall Time Scale (s)"
  w17 = $threshold
  # Testing Spectrum Monitor. Not as many indicators will
  # be on panel in final version.
  s1 = uninitialised  # shift register
  while {
    Is First Call() -> w18
    # Go back to the first carrier frequency and repeat
    s2 = 0  # shift register
    for (iteration -> i1) {
      w19 = each element of w5
      call "Set Carrier and LO_2.gvi"(Current Frequency=w19, niusrp in_2=w11, error in=w12) -> (Error=w20, Usrp.niUSRPClass=w21)
      call "Array Indices for Sub-band.gvi"(First call=w18, error in=w20, 2D(freq,ind)=s1, niusrp in=w21, IQ frac=w8) -> (Local Interests=w22, error out=w23, Usrp.niUSRPClass out=w24)
      # Get new carrier frequency
      for (N = w13) (iteration -> i2) {
        Get Current Time() -> (current time=w27)
        # Averaging Loop
        call "Read Data.gvi"(USRP Session Handle In=w24, error in=w23, Number of Samples=w6) -> (USRP Session Handle Out=w28, error out=w29, data=w30)
        Is Equal To 0(x=i2) -> w31
        call "Establish Sub-band.gvi"(Restart Averaging=w31, Frame Parameters=w7, Averaging Parameters=w10, error in=w29, Input Baseband IQ=w30) -> (Power Spectrum averaged Subset=w32, Window Properties=w33, error out=w34, Frame Parameters Out=w35, power spectrum current=w36)
        call "Gather Signals for Saving.gvi"(Local Interests=w22, power spectrum current=w36, Window Properties=w33) -> (Signal Data=w37, signals2D=w38)
        # w31: First Rx for this carrier?
        Logical Or(w34, $"Stop Capture") -> w39
        append w34 to w25
        append w38 to w26
        stop if w39
      }
      $signals3D <- w26
      call "Save Data to File ALT.gvi"(TimeStamp=w27, file path=w14, Signals3D=w26, Signal Data=w37)
      Merge Errors(w25) -> (error out=w40)
      Property Node(instance in=w28, error in=w40) -> ("Carrier Frequency"=w41, "LO Frequency"=w42, error out=w43, instance out=w44)
      $"Carrier Freq Out" <- w41
      $"Signal Data" <- w37
      $"LO Frequency" <- w42
      call "Aggregate Sub-band into Spectrum.gvi"(Frame Parameters=w35, Power Spectrum Subset=w32, Window Properties In=w33, Display=w15, Iteration=i1) -> (Spectrum to Plot=w45, Frame Parameters Out=w46, Spectrum Size=w47)
      call "Plot Spectrum.gvi"(Frame Parameters=w46, Spectrum to Plot In=w45) -> (Spectrum to Plot Out=w48, Frame Parameters out=w49)
      $"FFT Power Spectrum" <- w48
      $"Spectrum Size" <- w47
      next s2 = w42
      stop if w39
    }
    call "Signal Power Detection_2.gvi"(Power Spectrum=w48, threshold=w17, Frame Parameters Out=w49) -> (Power at those Freqs.=w50, Est. Freqs above Thresh=w51, count=w52, sub_band_ind=w53)
    call "Array Fill.gvi"(sub_band_ind=w53, Est. Freqs above Thresh=w51, Count=w52) -> (2D(freq,ind)=w54, number elements in array=w55)
    $"2D(freq,ind)" <- w54
    Build Cluster(w51, w50, w52, w55) -> w56
    $"Power Detection" <- w56
    Property Node(instance in=w48) -> ("IQ"=w57)
    call "Waterfal Plot Generator.gvi"(Magnitude=w57, Waterfall Time Scale (s)=w16) -> (Waterfall Plot=w58)
    $"Waterfall Plot" <- w58
    next s1 = w54
    stop if w39
  }
  call "niUSRP Abort.gvi"(Handle in=w44, error in (no error)=w43) -> (Handle out=w59, Error Out=w60)
  call "niUSRP Close Session.gvi"(handle in=w59, error in=w60) -> (error out=w61)
  $"error out" <- w61
  $"Carrier List" <- w5
  $"Samples per Acquisition" <- w6
  $"Frame Parameters Out" <- w7
