vi "Waterfal Plot Generator.gvi"   [LabVIEW Communications System Design Software 2.0.1]
inputs:
  "Magnitude": f64[]
  "Waterfall History Length": i32 = 5
outputs:
  "Waterfall Plot": f64[][]
diagram:
  Array Size(array=$Magnitude) -> (size(s)=w1)
  Is First Call() -> w2
  case (w2) {
    frame False, Default {
      w3 = default
    }
    frame True {
      Initialize Array(element=-120, size=w1, size=$"Waterfall History Length") -> w3
    }
  }
  Feedback Node(initial value=w3, input=w4) -> w5
  Insert Into Array(inArray=w5, index1=0, new=$Magnitude) -> w6
  Delete From Array(inArray=w6, length (1)=w1, index1=$"Waterfall History Length") -> w4
  $"Waterfall Plot" <- w4
