vi "Aggregate Spectrum.gvi"   [LabVIEW Communications System Design Software 2.0.1]
panel controls:
  "RX Parameters In": T1
  "Device Names": "niUSRPClass"
  "Averaging Parameters": "Averaging Parameters.gtype" = {"averaging mode"="No averaging", "weighting mode"="Exponential", "number of averages"=10}  # averaging parameters defines how the averaging is computed. The specifications of the parameters include the type of averaging, the type of weighting, and the number of averages.
  "Display": T4 = {"display unit"="Vrms", "dB type"="dB"}
panel indicators:
  "error out": error
  "FFT Power Spectrum": cluster{"f0": f64, "df": f64, "IQ": f64[]}
  "Samples per Acquisition": i64
  "Carrier Freq Out": f64
types:
  T1 = cluster{"IQ Sampling Rate [S/sec]": f64, "Gain [dB]": f64, "Active Antenna": string, "Reference Frequency": string, "Timebase Clock Source": string, "Start Carrier [Hz]": f64, "Stop Carrier [Hz]": f64, "Acq Duration [sec]": f64}
  T2 = enum{"No averaging", "Vector averaging", "RMS averaging", "Peak hold"}
  "Averaging Parameters.gtype" = cluster{"averaging mode": T2, "weighting mode": enum{"Linear", "Exponential"}, "number of averages": u32}
  T3 = enum{"Vrms", "Vpk", "Vrms^2", "Vpk^2", "Vrms/rtHz", "Vpk/rtHz", "Vrms^2/Hz", "Vpk^2/Hz"}
  T4 = cluster{"display unit": T3, "dB type": enum{"Linear", "dB", "dBm"}}
diagram:
  call "niUSRP Open Rx Session.gvi"(device names=$"Device Names") -> (error out=w1, session handle out=w2)
  call "Set Parameters.gvi"(RX Parameters In=$"RX Parameters In", IVI Refnum In=w2, error in (no error)=w1) -> (error out: HW RX Param subsetup=w3, IVI Refnum Out=w4, Test Carrier Frequencies=w5, Samples per Acquisition=w6, Frame Parameters Out=w7)
  $"Samples per Acquisition" <- w6
  w8 = $"Averaging Parameters"
  Property Node(instance in=$"RX Parameters In") -> ("Active Antenna"=w9)
  Property Node(instance in=w8) -> ("number of averages"=w10)
  w11 = $Display
  for (iteration -> i1) {
    w12 = each element of w5
    for (N = w10) (iteration -> i2) {
      call "USRP_NI_IQ.gvi"(IVI Refnum In=w4, error in=w3, Number of Samples=w6, Carrier Frequency=w12, Active Antenna=w9) -> (IVI Refnum Out=w13, error out=w14, data=w15, Carrier Freq Out=w16)
      $"Carrier Freq Out" <- w16
      Is Equal To 0(x=i2) -> w17
      call "USRP Aggregate Spectrum.gvi"(Frame Parameters=w7, Input Baseband IQ=w15, Iteration=i1, Averaging Parameters=w8, Restart Averaging=w17) -> (Window Properties=w18, Spectrum to Plot=w19, Frame Parameters Out=w20)
      call "USRP Plot Spectrum.gvi"(Frame Parameters=w20, Display=w11, Window Properties=w18, Spectrum to Plot In=w19) -> (Spectrum to Plot Out=w21)
      $"FFT Power Spectrum" <- w21
    }
  }
  call "niUSRP Close Session.gvi"(session handle=w13, error in=w14) -> (error out=w22)
  $"error out" <- w22
