vi "USRP_NI_IQ.gvi"   [LabVIEW Communications System Design Software 2.0.1]
inputs:
  "IVI Refnum In": "niUSRPClass"
  "error in": error
  "Number of Samples": i64
  "Carrier Frequency": f64
  "Active Antenna": string
outputs:
  "IVI Refnum Out": "niUSRPClass"
  "error out": error
  "data": c128[]
  "Carrier Freq Out": f64
diagram:
  case ($"error in") {
    frame No Error, Default {
      Property Node(instance in=$"IVI Refnum In", "Number of Samples Is Finite"=TRUE, "Number of Samples"=$"Number of Samples", "Carrier Frequency"=$"Carrier Frequency", "Active Antenna"=$"Active Antenna", error in=$"error in") -> (error out=w5, instance out=w6)
      call "niUSRP Commit.gvi"(session handle=w6, error in=w5) -> (session handle out=w7, error out=w8)
      call "niUSRP Initiate.gvi"(session handle=w7, error in=w8) -> (session handle out=w9, error out=w10)
      call "niUSRP Fetch Rx Data (CDB).gvi"(session handle=w9, number of samples=$"Number of Samples", error in=w10) -> (session handle out=w11, data=w2, error out=w12)
      call "niUSRP Abort.gvi"(session handle=w11, error in=w12) -> (session handle out=w3, error out=w1)
      w4 = $"Carrier Frequency"
    }
    frame Error {
      w1 = $"error in"
      w2 = c128[] []
      w3 = $"IVI Refnum In"
      w4 = $"Carrier Frequency"
    }
  }
  $"IVI Refnum Out" <- w3
  $"error out" <- w1
  $data <- w2
  $"Carrier Freq Out" <- w4
